# Grasshopper definition ANALYSIS_Slope HyperbolicRamp precise.gh (Grasshopper 1.0.7)

# ---- group: Curve samples
samples = Slider(500, range=10..1000)
period = DigitScroller(Scroller_Digits=12, Scroller_Prefix="Period", Scroller_Radix=9, Scroller_Value=13.5)
division = Division(A=samples, B=period)
range = Range(Domain=Domain(0, 1), Steps=expr("x-1", samples))
range_2 = Range(Domain=Domain(0, 1), Steps=division)
cull_i = CullIndex(List=range_2, Indices=0, Wrap=False)  # -> flatten(List)
repeat = RepeatData(Data=cull_i, Length=samples)
pt = ConstructPoint(XCoordinate=repeat, YCoordinate=range, ZCoordinate=0)

# ---- group: Settings
diameter = Slider(45, range=10..60)
height = Slider(90, range=10..100)
number_slider = Slider(150, range=0..170)

# ---- group: Hyperboloid
pt_2 = ConstructPoint(XCoordinate=expr("0.5 * x", diameter), YCoordinate=0, ZCoordinate=0)
Z = UnitZ(Factor=height)
move = Move(Geometry=pt_2, Motion=Z)  # -> Geometry, Transform
rotate = Rotate(Geometry=move.Geometry, Angle=degrees(number_slider), Plane=PlaneXY(0, 0, 0))  # -> Geometry, Transform
ln = Line(StartPoint=pt_2, EndPoint=rotate.Geometry)
revsrf = Revolution(Curve=ln, Axis=Line((0, 0, 0), (0, 0, 5)), Domain=Domain(0, 6.283185307))

# ---- group: Spiral
eval = EvaluateSurface(Surface=reparameterize(revsrf), Point=pt)  # -> Point, Normal, Frame
intcrv = Interpolate(Vertices=eval.Point, Degree=3, Periodic=False, KnotStyle=1)  # -> Curve, Length, Domain

# ---- group: Slope analysis
divide = DivideCurve(Curve=intcrv.Curve, Count=1000, Kinks=False)  # -> Points, Tangents, Parameters
devec = DeconstructVector(Vector=divide.Tangents)  # -> XComponent, YComponent, ZComponent
graph = QuickGraph(devec.ZComponent, SortOrder=0)
